# Grasshopper definition Bending.ghx (Grasshopper 0.9.76)
# plug-ins: Kangaroo2 Components

crv = Curve(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)
crv_2 = Curve(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)
divide = DivideCurve(Curve=crv, Count=25, Kinks=False)  # -> Points, Tangents, Parameters
divide_2 = DivideCurve(Curve=crv_2, Count=25, Kinks=False)  # -> Points, Tangents, Parameters
pline = PolyLine(Vertices=divide.Points, Closed=False)
pline_2 = PolyLine(Vertices=divide_2.Points, Closed=False)
explode = Explode(Curve=pline, Recursive=True)  # -> Segments, Vertices
panel = Panel(explode.Segments)
explode_2 = Explode(Curve=pline_2, Recursive=True)  # -> Segments, Vertices
panel_2 = Panel(explode_2.Segments)
shift = ShiftList(List=explode.Segments, Shift=1, Wrap=False)
shift_2 = ShiftList(List=explode_2.Segments, Shift=1, Wrap=False)
# Hold the left Control key and use the left mouse button to drag in the Rhino viewports. Right click while holding left mouse + left Control
# to add or remove Anchors
toggle = BooleanToggle(True)
# Hold the left Control key and use the left mouse button to drag in the Rhino viewports. Right click while holding left mouse + left Control
# to add or remove Anchors
button = Button()
short = ShortestList(ListA=explode.Segments, ListB=shift, TrimMode=2)  # -> ListA, ListB
button_2 = Button()
short_2 = ShortestList(ListA=explode_2.Segments, ListB=shift_2, TrimMode=2)  # -> ListA, ListB
grab = Grab(On=toggle, Strength=10, Range=3)  # -> Grab, Anchors
length_line = LengthLine(Line=explode.Segments, Length="2", Strength=10)
angle = Angle(LineA=short.ListA, LineB=short.ListB, RestAngle="0", Strength=1)
length_line_2 = LengthLine(Line=explode_2.Segments, Length="2", Strength=10)
angle_2 = Angle(LineA=short_2.ListA, LineB=short_2.ListB, RestAngle="0", Strength=1)
bouncysolver = BouncySolver(
    GoalObjects=[grab.Grab, length_line, angle],
    Reset=button,
    Threshold=1e-15,
    Tolerance=0.01,
    Damping=0.99,
    Iterations=10,
    On=True)  # -> I, V, O
solver = Solver(
    GoalObjects=[angle, grab.Grab, length_line],
    Reset=button,
    Restart=False,
    Parallel=True,
    Threshold=1e-15,
    Tolerance=0.01,
    AddCurrent=False,
    On=True)  # -> V, O
bouncysolver_2 = BouncySolver(
    GoalObjects=[length_line_2, angle_2],
    Reset=button_2,
    Threshold=1e-15,
    Tolerance=0.01,
    Damping=0.99,
    Iterations=10,
    On=True)  # -> I, V, O
solver_2 = Solver(
    GoalObjects=[angle_2, length_line_2],
    Reset=button_2,
    Restart=False,
    Parallel=True,
    Threshold=1e-15,
    Tolerance=0.01,
    AddCurrent=False,
    On=True)  # -> V, O
data = Data(solver.O)
data_2 = Data(bouncysolver.O)
data_3 = Data(solver_2.O)
data_4 = Data(bouncysolver_2.O)
