# Grasshopper definition Collision-Curve-X-Particle-2d.ghx (Grasshopper 0.9.76)
# plug-ins: Kangaroo2 Components

pt = Point([Point(-8, 34.30562263, 0), Point(9.52496961, 20.01699977, 0), Point(24.76432048, 11.02350394, 0), Point(13.49169548, -3.478222673, 0), Point(45.96791286, -18.42056565, 0), Point(47.66656448, 2.624432507, 0), Point(79.40037141, 13.60921183, 0), Point(30.57912998, -45.58654341, 0)])
number_slider = Slider(5, range=0..5)
pop2d = Populate2D(Region={Plane=PlaneXY(-30, 58, 0), Size=Domain2(u=0..131, v=0..73)}, Count=Slider(300, range=0..1000), Seed=1)
Y = UnitY(Factor=-0.01)
intcrv = Interpolate(Vertices=pt, Degree=3, Periodic=True, KnotStyle=1)  # -> Curve, Length, Domain
boundary = BoundarySurfaces(Edges=intcrv.Curve)
neg = Negative(Value=number_slider)
offset = Offset(Curve=intcrv.Curve, Distance=neg, Plane=PlaneXY(0, 0, 0), Corners=1)
cpc = CurvePointCollide(Points=pop2d, Curve=offset, Plane=PlaneXY(0, 0, 0), Interior=Toggle(False), Strength=10)
onplane = OnPlane(Points=pop2d, Plane=PlaneXY(0, 0, 0), Strength=1)
sc = SphereCollide(Points=pop2d, Radius=number_slider, Strength=10)
load = Load(Point=pop2d, ForceVector=Y)
reset = Button()
on = BooleanToggle(True)
solver = Solver(GoalObjects=[sc, cpc, load, onplane], Reset=reset, Threshold=1e-15, Tolerance=0.01, On=on)  # -> I, V, O
pt_2 = Point(solver.V)
cloud = CloudDisplay(Points=solver.V, Colours=RGB(35, 55, 186), Size=1.1, SpriteType=1)
cir = Circle(Plane=pt_2, Radius=number_slider)
panel = Panel(solver.O)
