# Grasshopper definition Collision-Mesh-Solid-MeshMachine-3.ghx (Grasshopper 0.9.76)
# plug-ins: MeshEdit Components, Python Interpreter, Kangaroo Components, PlanktonGh, Weaverbird, Kangaroo2 Components

number_slider = Slider(5, range=0..10)
custom_mesh_settings = SettingsCustom(
    StitchSeams=True,
    SimplePlanes=False,
    Refine=True,
    MinCount=16,
    MaxCount=400,
    AspectRatio=20,
    MaxDistance=0,
    MaxAngle=20,
    MinEdge=number_slider,
    MaxEdge=number_slider)
number_slider_2 = Slider(48, range=0..100)
number_slider_3 = Slider(24, range=0..100)

# ---- group: cloth
brep = Brep(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)

# ---- group: Cylinder
brep_2 = Brep(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)

# ----
number_slider_4 = Slider(30, range=0..100)

# ---- group: bunny
brep_3 = Brep(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)

# ---- group: teapot
brep_4 = Brep(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)

# ---- group: goat
brep_5 = Brep(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)

# ---- group: ob
mesh = Mesh(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)

# ----
mesh_2 = Mesh(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)
mesh_3 = Mesh(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)
brep_6 = Brep(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)
preview = CustomPreview(
    Geometry=brep,
    Shader={ambient=RGB(0, 0, 0), diffuse=RGB(255, 105, 180), emission=RGB(76, 32, 54), shine=0.5, specular=RGB(255, 255, 255), transparency=0})
tri = Triangulate(Mesh=mesh_3)  # -> Mesh, Count
mesh_4 = MeshBrep(Brep=brep_6, Settings=custom_mesh_settings)
rectangle = Rectangle(Plane=PlaneXY(0, 0, 0), XSize="-15 to 35", YSize="-15 to 35", Radius=0)  # -> Rectangle, Length
panel = Panel(tri.Mesh)
move = Move(Geometry=brep_3, Motion="10,15,-85")  # -> Geometry, Transform
tri_2 = Triangulate(Mesh=mesh_2)  # -> Mesh, Count
sdivide = DivideSurface(Surface=brep, UCount=number_slider_2, VCount=number_slider_3)  # -> flatten(Points), Normals, Parameters
box = CenterBox(Base=PlaneXY(0, 0, 0), X=number_slider_4, Y=number_slider_4, Z=Slider(5, range=0..10))
addition = Addition(A=number_slider_2, B=1)
addition_2 = Addition(A=number_slider_3, B=1)
clean = CombineClean(Meshes=tri.Mesh)
panel_2 = Panel(clean)
Z = UnitZ(Factor=Slider(20, range=0..20))
mesh_5 = MeshBrep(
    Brep=move.Geometry,
    Settings={GridMaxCount=0, GridMinCount=16, JaggedSeams=False, MaxEdgeLength=0, MinEdgeLength=0.0001, MinTolerance=0, Refine=True, RefineAngle=0, RelativeTolerance=0.65, SimplePlanes=True, Tolerance=0})
mbox = MeshBox(Base=box, XCount=10, YCount=10, ZCount=10)
demesh = DeconstructMesh(Mesh=tri_2.Mesh)  # -> Vertices, Faces, Colours, Normals
W = WidthCount(30)
move_2 = Move(Geometry=rectangle.Rectangle, Motion=Z)  # -> Geometry, Transform
frompoints = MeshFromPoints(Points=sdivide.Points, UDirection=addition, VDirection=addition_2)
pt = Point(demesh.Vertices)
move_3 = Move(Geometry=mbox, Motion="0,0,80")  # -> Geometry, Transform
mplane = MeshPlane(Boundary=move_2.Geometry, WidthCount=W, HeightCount=W)  # -> Mesh, Area
medges = MeshEdges(Mesh=tri_2.Mesh)  # -> NakedEdges, InteriorEdges, NonManifoldEdges
Z_2 = UnitZ(Factor=-0.1)

# ---- group: preserving volume, and decreasing edge lengths for balloon
medges_2 = MeshEdges(Mesh=clean)  # -> NakedEdges, InteriorEdges, NonManifoldEdges
volume = Volume(Mesh=clean, Strength=0.1)
length_line = LengthLine(Line=medges_2.InteriorEdges, Length=0, Strength=0.1)

# ----
floor = Floor(Strength=1)
grab = Grab(On=True, Strength=1, Range=3)  # -> Grab, Anchors
panel_3 = Panel(move_3.Geometry)

# ---- group: cloth self-collision using spheres
sc = SphereCollide(Points=demesh.Vertices, Radius=1.7, Strength=1)

# ----
panel_4 = Panel(mesh)

# ---- group: 2-way collision between balloon and cloth
spc = SolidPointCollide(Points=demesh.Vertices, Solid=clean, Interior=False, Unidirectional=False, Strength=1)

# ----
length_line_2 = LengthLine(Line=[medges.InteriorEdges, medges.NakedEdges], Strength=10)
load = Load(Point=demesh.Vertices, ForceVector=Z_2)
mesh_6 = Mesh(mesh_5)
clean_2 = CombineClean(Meshes=mesh_6)
medges_3 = MeshEdges(Mesh=clean_2)  # -> NakedEdges, InteriorEdges, NonManifoldEdges
show = Show(G=clean)
show_2 = Show(G=tri_2.Mesh)
panel_5 = Panel(clean_2)
mesh_7 = Mesh(clean_2)

# ---- group: torus
brep_7 = Brep(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)

# ---- group: Box
brep_8 = Brep(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)

# ---- group: T
brep_9 = Brep(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)

# ----
merge = Merge(
    Data1=grab.Grab,
    Data2=length_line_2,
    Data3=load,
    Data4=sc,
    Data5=show_2,
    Data6=spc,
    Data7=show,
    Data8=length_line,
    Data9=volume,
    Data10=floor)  # -> flatten(Result)
entwine = Entwine(
    Branch00=[length_line_2, load, floor, volume, spc, length_line, sc, grab.Grab],
    Branch01=show_2,
    Branch02=show,
    FlattenInputs=True)
mesh_8 = Mesh(mesh_7)
brep_10 = Brep(brep_9)
brep_11 = Brep(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)
demesh_2 = DeconstructMesh(Mesh=mesh_8)  # -> Vertices, Faces, Colours, Normals
mesh_9 = MeshBrep(
    Brep=brep_10,
    Settings={GridMaxCount=0, GridMinCount=16, JaggedSeams=False, MaxEdgeLength=0, MinEdgeLength=0.0001, MinTolerance=0, Refine=True, RefineAngle=0, RelativeTolerance=0.65, SimplePlanes=True, Tolerance=0})
panel_6 = Panel(brep_11)
medges_4 = MeshEdges(Mesh=mesh_8)  # -> NakedEdges, InteriorEdges, NonManifoldEdges
solver = Solver(GoalObjects=merge, Reset=Button(), Threshold=1e-15, Tolerance=0.01, On=Toggle(True))  # -> I, V, O
len = Length(Curve=medges_4.InteriorEdges)
mesh_10 = MeshBrep(
    Brep=brep_11,
    Settings={GridMaxCount=0, GridMinCount=16, JaggedSeams=False, MaxEdgeLength=0, MinEdgeLength=0.0001, MinTolerance=0, Refine=True, RefineAngle=0, RelativeTolerance=0.65, SimplePlanes=True, Tolerance=0})
panel_7 = Panel(mesh_9)
rec = Rectangle({Plane=PlaneXY(-117, -101.5, 0), Size=Domain2(u=0..228, v=0..207)})
avr = Average(Input=len)
mesh_11 = Mesh(solver.O)
demesh_3 = DeconstructMesh(Mesh=mesh_10)  # -> Vertices, Faces, Colours, Normals
boundary = BoundarySurfaces(Edges=rec)
multiplication = Multiplication(A=avr, B=0.5)
preview_2 = CustomPreview(
    Geometry=mesh_11,
    Shader={ambient=RGB(0, 0, 0), diffuse=RGB(255, 105, 180), emission=RGB(76, 32, 54), shine=0.5, specular=RGB(255, 255, 255), transparency=0})
pt_2 = Point(demesh_3.Vertices)
pt_3 = Point(demesh_2.Vertices)
crv = Curve([medges_4.NakedEdges, medges_4.InteriorEdges])
Z_3 = UnitZ(Factor="-0.1")
sc_2 = SphereCollide(Points=demesh_2.Vertices, Radius=multiplication, Strength=10)
smooth = Smooth(M=mesh_8, Strength=1)
floor_2 = Floor(Strength=1)
length_line_3 = LengthLine(Line=crv, Strength=10)
rigidbody = RigidBody(Part=mesh_10, Points=demesh_3.Vertices, Strength=10)  # -> RigidBody, Planes
show_3 = Show(G=mesh_8)
show_4 = Show(G=mesh_10)
spc_2 = SolidPointCollide(Points=pt_3, Solid=brep_11, Interior=Toggle(False), Unidirectional=Toggle(False), Strength=1)
load_2 = Load(Point=demesh_3.Vertices, ForceVector=Z_3)
merge_2 = Merge(
    Data1=show_4,
    Data2=load_2,
    Data3=spc_2,
    Data4=sc_2,
    Data5=show_3,
    Data6=floor_2,
    Data7=length_line_3,
    Data8=rigidbody.RigidBody)  # -> flatten(Result)
solver_2 = Solver(GoalObjects=merge_2, Reset=Button(), Threshold=1e-15, Tolerance=0.01, On=Toggle(False))  # -> I, V, O
data = Data(solver_2.O)
brep_12 = Brep(data)
mesh_12 = Mesh(data)
clean_3 = CleanTree(RemoveNulls=True, RemoveInvalid=True, RemoveEmpty=False, Tree=brep_12)
clean_4 = CleanTree(RemoveNulls=True, RemoveInvalid=True, RemoveEmpty=False, Tree=mesh_12)
merge_3 = Merge(Data1=boundary)
brep_13 = Brep(clean_3)
mesh_13 = Mesh(clean_4)
preview_3 = CustomPreview(Geometry=merge_3, Shader=ColourSwatch(SwatchColor=RGBA(255, 188, 255, 150)))
preview_4 = CustomPreview(Geometry=mesh_13, Shader=ColourSwatch(SwatchColor=RGBA(181, 255, 255, 150)))
mesh_14 = Mesh(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)
mesh_15 = Mesh()
medges_5 = MeshEdges(Mesh=mesh_15)  # -> NakedEdges, InteriorEdges, NonManifoldEdges
mesh_16 = Mesh(mesh_15)
Z_4 = UnitZ(Factor=Slider(0.5, range=0..1))
move_4 = Move(Geometry=mesh_16, Motion=Z_4)  # -> Geometry, Transform
wbloop = WeaverbirdsLoopSubdivision(MeshCurves=move_4.Geometry, Level=Slider(3, range=0..10), SmoothNakedEdges=1)
preview_5 = CustomPreview(
    Geometry=move_4.Geometry,
    Shader={ambient=RGB(0, 0, 0), diffuse=RGB(255, 105, 180), emission=RGB(76, 32, 54), shine=0.5, specular=RGB(255, 255, 255), transparency=0})
mesh_17 = Mesh(wbloop)
medges_6 = MeshEdges(Mesh=mesh_17)  # -> NakedEdges, InteriorEdges, NonManifoldEdges
medges_7 = MeshEdges(Mesh=mesh_17)  # -> NakedEdges, InteriorEdges, NonManifoldEdges
viewer = ParamViewer(medges_7.NakedEdges)
crv_2 = Curve(medges_7.NakedEdges)
join = JoinCurves(Curves=medges_7.NakedEdges, Preserve=False)
cp = ControlPoints(Curve=join)  # -> Points, Weights, Knots
viewer_2 = ParamViewer(cp.Points)
duppt = RemoveDuplicatePts(Points=cp.Points, Tolerance=0.01)
multiplication_2 = Multiplication(A=Slider(10, range=0..10), B=Slider(3.97, range=1..4))
viewer_3 = ParamViewer(duppt)
sequence = Sequence(Frames=Slider(10, range=0..10))
num = Number(Slider(4, range=0..300))
meshmachine = MeshMachine(
    Geometry=mesh_17,
    Length=num,
    FixVertices=duppt,
    Flip=1,
    PullStrength=0.8,
    CurvatureAdaptivity=0,
    BoundaryScale=1,
    BoundaryDistance=5,
    Exponent=2,
    Background=0.5,
    Iterations=Slider(1, range=0..10),
    Reset=sequence)
pmesh = PlanktonMesh(flatten(meshmachine))
rev = ReverseList(List=pmesh)
viewer_4 = ParamViewer(pmesh)
panel_8 = Panel(pmesh)
item = ListItem(List=rev, Index=0, Wrap=True)
mesh_18 = Mesh(item)
medges_8 = MeshEdges(Mesh=mesh_18)  # -> NakedEdges, InteriorEdges, NonManifoldEdges
panel_9 = Panel(mesh_18)
number_slider_5 = Slider(0.8, range=0..1)  # disabled
demesh_4 = DeconstructMesh(Mesh=mesh_18)  # -> Vertices, Faces, Colours, Normals; disabled
lng = ListLength(List=demesh_4.Faces)  # disabled
multiplication_3 = Multiplication(A=lng, B=number_slider_5)  # disabled
toggle = BooleanToggle(False)  # disabled
toggle_2 = BooleanToggle(False)  # disabled
int = Integer(multiplication_3)  # disabled
python = PythonScript(x=mesh_18, y=int, z=toggle, u=toggle_2)  # -> out, a, b, c, d; inputs x: Mesh, y: Int32, z: Boolean, u: Boolean; disabled
# ---------- python: Python ----------
import rhinoscriptsyntax as rs
import Rhino
import scriptcontext as sc

a = x
b = y

c = Rhino.Geometry.Mesh.Reduce(x,y,z,10,u)
d = rs.MeshFaceCount(x)
# ---------- end python ----------
panel_10 = Panel(python.a)
panel_11 = Panel(python.b)
panel_12 = Panel(python.c)
panel_13 = Panel(python.d)
