# Grasshopper definition Collision-Mesh-Solid-MeshMachine-4.ghx (Grasshopper 0.9.76)
# plug-ins: MeshEdit Components, Python Interpreter, Kangaroo Components, PlanktonGh, Weaverbird, Kangaroo2 Components

# ---- group: ob
mesh = Mesh(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)

# ---- group: bunny
brep = Brep(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)

# ---- group: goat
brep_2 = Brep(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)

# ---- group: teapot
brep_3 = Brep(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)

# ---- group: Sphere-MeshMachine
brep_4 = Brep(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)

# ---- group: 1st-Result
mesh_2 = Mesh(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)

# ----
panel = Panel("0,10,0")
number_slider = Slider(30, range=0..100)
panel_2 = Panel(mesh)
bbox = BoundingBox(Content=brep, Plane=PlaneXY(0, 0, 0))  # -> Box, Box_2

# ---- group: cloth
brep_5 = Brep(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)

# ---- group: Cylinder
brep_6 = Brep(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)

# ----
move = Move(Geometry=brep, Motion="-50,10,0")  # -> Geometry, Transform
number_slider_2 = Slider(48, range=0..100)
number_slider_3 = Slider(24, range=0..100)
volume = Volume(Geometry=bbox.Box)  # -> Volume, Centroid
mesh_3 = MeshBrep(
    Brep=move.Geometry,
    Settings={GridMaxCount=0, GridMinCount=16, JaggedSeams=False, MaxEdgeLength=0, MinEdgeLength=0.0001, MinTolerance=0, Refine=True, RefineAngle=0, RelativeTolerance=0.65, SimplePlanes=True, Tolerance=0})
rectangle = Rectangle(Plane=PlaneXY(0, 0, 0), XSize="-15 to 35", YSize="-15 to 35", Radius=0)  # -> Rectangle, Length
pi = Pi(Factor=1)
Z = UnitZ(Factor=Slider(20, range=0..20))
box = CenterBox(Base=PlaneXY(0, 0, 0), X=number_slider, Y=number_slider, Z=Slider(5, range=0..10))
panel_3 = Panel(mesh_3)
preview = CustomPreview(
    Geometry=brep_5,
    Shader={ambient=RGB(0, 0, 0), diffuse=RGB(255, 105, 180), emission=RGB(76, 32, 54), shine=0.5, specular=RGB(255, 255, 255), transparency=0})
cbrt = CubeRoot(Value=volume.Volume)
division = Division(A=volume.Volume, B=pi)
division_2 = Division(A="3", B="4")
mesh_4 = Mesh(mesh_3)
mbox = MeshBox(Base=box, XCount=10, YCount=10, ZCount=10)
multiplication = Multiplication(A=division, B=division_2)
sdivide = DivideSurface(Surface=brep_5, UCount=number_slider_2, VCount=number_slider_3)  # -> flatten(Points), Normals, Parameters
move_2 = Move(Geometry=rectangle.Rectangle, Motion=Z)  # -> Geometry, Transform
W = WidthCount(30)
addition = Addition(A=number_slider_2, B=1)
addition_2 = Addition(A=number_slider_3, B=1)
cbrt_2 = CubeRoot(Value=multiplication)
move_3 = Move(Geometry=mbox, Motion="0,0,80")  # -> Geometry, Transform
sph = Sphere(Base=volume.Centroid, Radius=cbrt_2)
mplane = MeshPlane(Boundary=move_2.Geometry, WidthCount=W, HeightCount=W)  # -> Mesh, Area
clean = CombineClean(Meshes=mesh_4)
frompoints = MeshFromPoints(Points=sdivide.Points, UDirection=addition, VDirection=addition_2)
msphereex = MeshSphereEx(Base=volume.Centroid, Radius=cbrt_2, Count=5)
volume_2 = Volume(Geometry=sph)  # -> Volume, Centroid
panel_4 = Panel(move_3.Geometry)
tri = Triangulate(Mesh=msphereex)  # -> Mesh, Count
medges = MeshEdges(Mesh=clean)  # -> NakedEdges, InteriorEdges, NonManifoldEdges
panel_5 = Panel(clean)
mesh_5 = Mesh(mesh_4)

# ---- group: torus
brep_7 = Brep(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)

# ---- group: Box
brep_8 = Brep(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)

# ---- group: T
brep_9 = Brep(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)

# ---- group: Chair-Box
brep_10 = Brep(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)

# ----
mesh_6 = Mesh(mesh_5)
brep_11 = Brep(brep_10)
mesh_7 = MeshBrep(
    Brep=brep_11,
    Settings={GridMaxCount=0, GridMinCount=16, JaggedSeams=False, MaxEdgeLength=0, MinEdgeLength=0.0001, MinTolerance=0, Refine=True, RefineAngle=0, RelativeTolerance=0.65, SimplePlanes=True, Tolerance=0})
demesh = DeconstructMesh(Mesh=mesh_6)  # -> Vertices, Faces, Colours, Normals
medges_2 = MeshEdges(Mesh=mesh_6)  # -> NakedEdges, InteriorEdges, NonManifoldEdges
len = Length(Curve=medges_2.InteriorEdges)
panel_6 = Panel(mesh_7)
rec = Rectangle({Plane=PlaneXY(-117, -101.5, 0), Size=Domain2(u=0..228, v=0..207)})
avr = Average(Input=len)
boundary = BoundarySurfaces(Edges=rec)
multiplication_2 = Multiplication(A=avr, B=Slider(0.45, range=0..0.99))
pt = Point(demesh.Vertices)
Z_2 = UnitZ(Factor="-0.03")
crv = Curve([medges_2.NakedEdges, medges_2.InteriorEdges])
volume_3 = MeshVolume(Mesh=mesh_6)  # -> Volume, Centroid
Z_3 = UnitZ(Factor=-0.1)
multiplication_3 = Multiplication(A=volume_3.Centroid, B=Slider(1, range=1..1.1))
sc = SphereCollide(Points=demesh.Vertices, Radius=multiplication_2, Strength=10)
smooth = Smooth(M=mesh_6, Strength=1)
floor = Floor(Strength=1)
length_line = LengthLine(Line=crv, Strength=10)
spc = SolidPointCollide(Points=demesh.Vertices, Solid=mesh_7, Interior=Toggle(False), Unidirectional="True", Strength=Slider(10, range=0..100))
volume_4 = Volume(Mesh=mesh_6, Strength=1)  # disabled
load = Load(Point=demesh.Vertices, ForceVector=Z_3)
show = Show(G=mesh_6)
merge = Merge(Data1=show, Data2=smooth, Data3=floor, Data4=length_line, Data5=spc, Data6=load, Data7=sc, Data8=volume_4)  # -> flatten(Result)
solver = Solver(GoalObjects=merge, Reset=Button(), Threshold=1e-15, Tolerance=0.01, On=Toggle(True))  # -> I, V, O
panel_7 = Panel(solver.O)
data = Data(solver.O)
brep_12 = Brep(data)
mesh_8 = Mesh(data)
clean_2 = CleanTree(RemoveNulls=True, RemoveInvalid=True, RemoveEmpty=False, Tree=brep_12)
clean_3 = CleanTree(RemoveNulls=True, RemoveInvalid=True, RemoveEmpty=False, Tree=mesh_8)
merge_2 = Merge(Data1=brep_11, Data2=boundary)
mesh_9 = Mesh(clean_3)
preview_2 = CustomPreview(Geometry=merge_2, Shader=ColourSwatch(SwatchColor=RGBA(255, 188, 255, 150)))
preview_3 = CustomPreview(Geometry=mesh_9, Shader=ColourSwatch(SwatchColor=RGBA(154, 247, 255, 150)))
mesh_10 = Mesh(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)
mesh_11 = Mesh(mesh_10)
medges_3 = MeshEdges(Mesh=mesh_11)  # -> NakedEdges, InteriorEdges, NonManifoldEdges
mesh_12 = Mesh(mesh_11)
Z_4 = UnitZ(Factor=Slider(0.5, range=0..1))
move_4 = Move(Geometry=mesh_12, Motion=Z_4)  # -> Geometry, Transform
preview_4 = CustomPreview(
    Geometry=move_4.Geometry,
    Shader={ambient=RGB(0, 0, 0), diffuse=RGB(255, 105, 180), emission=RGB(76, 32, 54), shine=0.5, specular=RGB(255, 255, 255), transparency=0})
wbloop = WeaverbirdsLoopSubdivision(MeshCurves=move_4.Geometry, Level=Slider(3, range=0..10), SmoothNakedEdges=1)
mesh_13 = Mesh(move_4.Geometry)
medges_4 = MeshEdges(Mesh=mesh_13)  # -> NakedEdges, InteriorEdges, NonManifoldEdges
medges_5 = MeshEdges(Mesh=mesh_13)  # -> NakedEdges, InteriorEdges, NonManifoldEdges
viewer = ParamViewer(medges_5.NakedEdges)
crv_2 = Curve(medges_5.NakedEdges)
join = JoinCurves(Curves=medges_5.NakedEdges, Preserve=False)
cp = ControlPoints(Curve=join)  # -> Points, Weights, Knots
viewer_2 = ParamViewer(cp.Points)
duppt = RemoveDuplicatePts(Points=cp.Points, Tolerance=0.01)
multiplication_4 = Multiplication(A=Slider(10, range=0..10), B=Slider(3.97, range=1..4))
viewer_3 = ParamViewer(duppt)
sequence = Sequence(Frames=Slider(10, range=0..10))
num = Number(Slider(12, range=0..300))
meshmachine = MeshMachine(
    Geometry=mesh_13,
    Length=num,
    FixVertices=duppt,
    Flip=1,
    PullStrength=0.8,
    CurvatureAdaptivity=0,
    BoundaryScale=1,
    BoundaryDistance=5,
    Exponent=2,
    Background=0.5,
    Iterations=Slider(1, range=0..10),
    Reset=sequence)
pmesh = PlanktonMesh(flatten(meshmachine))
rev = ReverseList(List=pmesh)
viewer_4 = ParamViewer(pmesh)
panel_8 = Panel(pmesh)
item = ListItem(List=rev, Index=0, Wrap=True)
mesh_14 = Mesh(item)
medges_6 = MeshEdges(Mesh=mesh_14)  # -> NakedEdges, InteriorEdges, NonManifoldEdges
panel_9 = Panel(mesh_14)
demesh_2 = DeconstructMesh(Mesh=mesh_14)  # -> Vertices, Faces, Colours, Normals
lng = ListLength(List=demesh_2.Faces)
multiplication_5 = Multiplication(A=lng, B=Slider(0.8, range=0..1))
int = Integer(multiplication_5)
python = PythonScript(x=mesh_14, y=int, z=Toggle(False), u=Toggle(False))  # -> out, a, b, c, d; inputs x: Mesh, y: Int32, z: Boolean, u: Boolean
# ---------- python: Python ----------
import rhinoscriptsyntax as rs
import Rhino
import scriptcontext as sc

a = x
b = y

c = Rhino.Geometry.Mesh.Reduce(x,y,z,10,u)
d = rs.MeshFaceCount(x)
# ---------- end python ----------
panel_10 = Panel(python.a)
panel_11 = Panel(python.b)
panel_12 = Panel(python.c)
panel_13 = Panel(python.d)
