# Grasshopper definition Flag-Wind.ghx (Grasshopper 0.9.76)
# plug-ins: Kangaroo2 Components

pt = Point([Point(5, 0, 15), Point(5, 0, 5)])
mplane = MeshPlane(Boundary={Plane=PlaneXZ(5, 0, 5), Size=Domain2(u=0..15, v=0..10)}, WidthCount=15, HeightCount=10)  # -> Mesh, Area
pt_2 = Point([Point(5, 0, 15), Point(5, 0, 5)])
mesh = Mesh(<mesh referenced from the Rhino model>)
mplane_2 = MeshPlane(Boundary={Plane=PlaneXZ(5, 0, 5), Size=Domain2(u=0..15, v=0..10)}, WidthCount=15, HeightCount=10)  # -> Mesh, Area
vec = Vector(Vector(19, 17, 0))
vec_2 = Vector(Vector(19, 17, 0))
multiplication = Multiplication(A=vec, B=Slider(0.075, range=0..1))
tri = Triangulate(Mesh=mesh)  # -> Mesh, Count
multiplication_2 = Multiplication(A=vec_2, B=Slider(0.075, range=0..1))
tri_2 = Triangulate(Mesh=mplane_2.Mesh)  # -> Mesh, Count
item = ListItem(List=pt, Index="0", Wrap=True)  # -> Item, Item1
vdis = VectorDisplay(Anchor=item.Item, Vector=vec)
anchor = Anchor(Point=pt, Strength=10000)
item_2 = ListItem(List=pt_2, Index="0", Wrap=True)  # -> Item, Item1
ln = Line(StartPoint=item_2.Item, EndPoint=item_2.Item1)
curvepoint = PointOnCurve(ln, parameter=0.5)
vdis_2 = VectorDisplay(Anchor=item_2.Item, Vector=vec_2)
anchor_2 = Anchor(Point=[pt_2, curvepoint], Strength=10000)
devec = DeconstructVector(Vector=item.Item1)  # -> XComponent, YComponent, ZComponent
medges = MeshEdges(Mesh=tri.Mesh)  # -> NakedEdges, InteriorEdges, NonManifoldEdges
show = Show(G=mesh)
medges_2 = MeshEdges(Mesh=tri_2.Mesh)  # -> NakedEdges, InteriorEdges, NonManifoldEdges
devec_2 = DeconstructVector(Vector=item_2.Item1)  # -> XComponent, YComponent, ZComponent
show_2 = Show(G=mplane_2.Mesh)
pt_3 = ConstructPoint(XCoordinate=devec.XComponent, YCoordinate=devec.YComponent, ZCoordinate="0")
smooth = Smooth(M=tri.Mesh, Strength=1)
pt_4 = ConstructPoint(XCoordinate=devec_2.XComponent, YCoordinate=devec_2.YComponent, ZCoordinate="0")
length_line = LengthLine(Line=[medges.NakedEdges, medges.InteriorEdges], Strength=10)
wind = Wind(Mesh=tri.Mesh, WindVector=multiplication)
wind_2 = Wind(Mesh=tri_2.Mesh, WindVector=multiplication_2)
smooth_2 = Smooth(M=tri_2.Mesh, Strength=1)
length_line_2 = LengthLine(Line=[medges_2.NakedEdges, medges_2.InteriorEdges], Strength=10)
ln_2 = Line(StartPoint=item.Item, EndPoint=pt_3)
ln_3 = Line(StartPoint=item_2.Item, EndPoint=pt_4)
bouncysolver = BouncySolver(
    GoalObjects=[length_line, show, anchor, wind, smooth],
    Reset=False,
    Threshold=1e-15,
    Tolerance=0.01,
    Damping=0.99,
    Iterations=2,
    On=Toggle(True))  # -> I, V, O
bouncysolver_2 = BouncySolver(
    GoalObjects=[length_line_2, show_2, anchor_2, wind_2, smooth_2],
    Reset=False,
    Threshold=1e-15,
    Tolerance=0.01,
    Damping=0.99,
    Iterations=2,
    On=True)  # -> I, V, O
panel = Panel(bouncysolver.I)
data = Data(bouncysolver.O)
panel_2 = Panel(bouncysolver_2.I)
panel_3 = Panel(bouncysolver.V)
data_2 = Data(bouncysolver_2.O)
panel_4 = Panel(bouncysolver_2.V)
panel_5 = Panel(data)
panel_6 = Panel(data_2)
