# Grasshopper definition MeshMap-Morphing.ghx (Grasshopper 0.9.76)
# plug-ins: Kangaroo2 Components

# ---- group: source rectangle
mesh = Mesh(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)

# ---- group: target rectangle
mesh_2 = Mesh(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)

# ---- group: mesh to transform
mesh_3 = Mesh(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)

# ----
preview = CustomPreview(
    Geometry=mesh_3,
    Shader={ambient=RGB(0, 0, 0), diffuse=RGB(255, 105, 180), emission=RGB(76, 32, 54), shine=0.5, specular=RGB(255, 255, 255), transparency=0})
demesh = DeconstructMesh(Mesh=mesh_3)  # -> Vertices, Faces, Colours, Normals
corners = Corners(mesh=mesh)
corners_2 = Corners(mesh=mesh_2)
meshmap = MeshMap(SourceMesh=mesh, TargetMesh=mesh_2, Point=demesh.Vertices, Distance=1)
vec2pt = Vector2Pt(PointA=corners, PointB=corners_2, Unitize=False)  # -> Vector, Length
vdis = VectorDisplay(Anchor=corners, Vector=vec2pt.Vector)
conmesh = ConstructMesh(Vertices=meshmap, Faces=demesh.Faces)
mesh_4 = Mesh(conmesh)
preview_2 = CustomPreview(
    Geometry=mesh_4,
    Shader={ambient=RGB(0, 0, 0), diffuse=RGB(255, 105, 180), emission=RGB(76, 32, 54), shine=0.5, specular=RGB(255, 255, 255), transparency=0})

# ==== cluster Corners: Find the boundary corner points of a quad mesh
mesh = ClusterInput()
mesh_2 = Mesh(mesh)
nv = NakedVertices(Mesh=mesh_2)  # -> ClothedIndex, NakedIndex, ClothedPts, NakedPts
vn = VertexNeighbours(Mesh=mesh_2, VertexNumber=nv.NakedIndex)  # -> graft(Vertex), Neighbours, Normal
lng = ListLength(List=vn.Neighbours)
equals = Equality(FirstNumber=lng, SecondNumber=3)  # -> Equality, Inequality
cull = CullPattern(List=vn.Vertex, CullPattern=equals.Inequality)
pshift = ShiftPaths(Data=cull, Offset=-1)
D = ClusterOutput(pshift)
