# Grasshopper definition Tensegrity-1-2.ghx (Grasshopper 0.9.76)
# plug-ins: Kangaroo Components, Kangaroo2 Components

Z = UnitZ(Factor=Slider(1.7, range=0..10))
xy = XYPlane(Origin=Point(0, 0, 0))
move = Move(Geometry=xy, Motion=Z)  # -> Geometry, Transform

# ---- group: Cable
cables = Curve([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])

# ----
struts = Curve([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])
polygon = Polygon(Plane=move.Geometry, Radius=Slider(1, range=0..10), Segments=Slider(3, range=0..10), FilletRadius=0)  # -> Polygon, Length
Z_2 = UnitZ(Factor=Slider(1.7, range=0..10))
div = DivideDomain(Domain=Domain(0, 1), Count=10)

# ---- group: Cable pre-tension
slider = Slider(0.644, range=0..1)

# ----
move_2 = Move(Geometry=polygon.Polygon, Motion=Z_2)  # -> Geometry, Transform
subcrv = SubCurve(BaseCurve=reparameterize(graft(cables)), Domain=div)
end = EndPoints(Curve=struts)  # -> Start, End
cp = ControlPoints(Curve=polygon.Polygon)  # -> Points, Weights, Knots
cp_2 = ControlPoints(Curve=move_2.Geometry)  # -> Points, Weights, Knots

# ---- group: Gravity
slider_2 = Slider(-100, range=-100..900)

# ----
len = Length(Curve=subcrv)
springs = SpringsFromLine(
    Connection=struts,
    Stiffness=5000,
    Damping=10,
    RestLength=struts,
    Cutoff=0,
    CompressionFail=0,
    TensileFail=0,
    Plasticity=0)
duppt = RemoveDuplicatePts(Points=cp_2.Points, Tolerance=0.01)
duppt_2 = RemoveDuplicatePts(Points=cp.Points, Tolerance=0.01)
kangaroo_settings = KangarooSettings(
    Tolerance=0.001,
    TimeStep=0.01,
    SubIterations=20,
    Floor=True,
    Drag=1,
    Restitution=0.7,
    StaticFriction=10,
    KineticFriction=10,
    Settle=2,
    Tumble=1,
    Sound=False,
    Solver=0)
multiplication = Multiplication(A=len, B=slider)
line = Line([subcrv, struts])
Z_3 = UnitZ(Factor=slider_2)
springs_2 = SpringsFromLine(
    Connection=subcrv,
    Stiffness=1000,
    Damping=10,
    RestLength=multiplication,
    Cutoff=0,
    CompressionFail=0,
    TensileFail=0,
    Plasticity=0)
shift = ShiftList(List=duppt, Shift=1, Wrap=True)
explode = Explode(Curve=polygon.Polygon, Recursive=True)  # -> Segments, Vertices
explode_2 = Explode(Curve=move_2.Geometry, Recursive=True)  # -> Segments, Vertices
ln = Line(StartPoint=duppt_2, EndPoint=duppt)
ln_2 = Line(StartPoint=duppt_2, EndPoint=shift)
uforce = UnaryForce(Point=[end.Start, end.End], Force=Z_3)
merge = Merge(Data1=ln, Data2=explode.Segments, Data3=explode_2.Segments)  # -> flatten(Result)
len_2 = Length(Curve=merge)
merge_2 = Merge(Data1=flatten(polygon.Polygon), Data2=flatten(move_2.Geometry), Data3=flatten(ln), Data4=flatten(ln_2))

timer = Timer(TimerInterval=1, Target=kangaroo)  # disabled

multiplication_2 = Multiplication(A=len_2, B=Slider(0.505, range=0..1))
length_line = LengthLine(Line=ln_2, Length=ln_2, Strength=Slider(1000, range=0..1000))
length_line_2 = LengthLine(Line=merge, Length=multiplication_2, Strength=10)
kangaroo = KangarooPhysics(
    ForceObjects=flatten([springs_2, springs, uforce]),
    Settings=kangaroo_settings,
    Geometry=line,
    SimulationReset=Toggle(True))  # -> Out, Iterations, ParticlesOut, GeometryOut, KE
show = Show(G=merge_2)
merge_3 = Merge(Data1=flatten(show), Data2=flatten(length_line), Data3=flatten(length_line_2))
toggle = BooleanToggle(True)
button = Button()
geo = Geometry(kangaroo.GeometryOut)
panel = Panel(geo)
bool = Boolean(True)
branch = TreeBranch(Tree=geo, Path="{0}", MaintainPaths=False)
simplify = SimplifyTree(Tree=geo, Front=bool)
viewer = ParamViewer(geo)
solver = Solver(
    GoalObjects=merge_3,
    Reset=button,
    Restart=False,
    Parallel=True,
    Threshold=1e-15,
    Tolerance=0.01,
    AddCurrent=False,
    On=toggle)  # -> V, O
bouncysolver = BouncySolver(GoalObjects=merge_3, Reset=button, Threshold=1e-15, Tolerance=0.01, Damping=0.99, Iterations=10, On=toggle)  # -> I, V, O
pipe = Pipe(Curve=branch, Radius=1, Caps=0)
viewer_2 = ParamViewer(simplify)
lng = ListLength(List=merge_2)  # -> expr("x-1", Length)
viewer_3 = ParamViewer(branch)
subset = SubList(List=solver.O, Domain=lng, Wrap=True)  # -> List, Index
split = SplitList(List=subset.List, Index=Slider(5, range=0..10))  # -> ListA, ListB
pipe_2 = Pipe(Curve=split.ListB, Radius=Slider(0.046, range=0..1), Caps=0)
preview = CustomPreview(Geometry=pipe_2, Shader=ColourSwatch(SwatchColor=RGB(255, 56, 56)))
preview_2 = CustomPreview(Geometry=split.ListA, Shader=ColourSwatch(SwatchColor=RGB(0, 0, 0)))
